# Grasshopper definition Yanru_Project1_Final.gh (Grasshopper 1.0.7)

Z = UnitZ(Factor=Slider(26.315, range=0..40))
X = UnitX(Factor=Slider(8.212, range=0..40))
offset = OffsetSurface(Distance=0, Retrim=True)

pt = ConstructPoint(XCoordinate=Slider(0, range=0..10), YCoordinate=Slider(0, range=0..10), ZCoordinate=0)
Z_2 = UnitZ(Factor=Slider(80, range=0..90))
move = Move(Geometry=Z_2, Motion=pt)  # -> Geometry, Transform

polygon = Polygon(Plane=pt, Radius=Slider(60, range=0..80), Segments=Slider(3, range=0..10), FilletRadius=0)  # -> Polygon, Length

boundary = BoundarySurfaces(Edges=polygon.Polygon)
extr = ExtrudePoint(Base=boundary, Point=move.Geometry)

deplane = DeconstructPlane(Plane=boundary)  # -> Origin, XAxis, YAxis, ZAxis
Y = UnitY(Factor=Slider(103.828, range=0..110))
pt_2 = Point(deplane.Origin)
move_2 = Move(Geometry=Y, Motion=pt_2)  # -> Geometry, Transform
pt_3 = Point(move_2.Geometry)
X_2 = UnitX(Factor=Slider(2.476, range=0..10))
ln = Line(StartPoint=pt_2, EndPoint=pt_3)
move_3 = Move(Geometry=ln, Motion=X_2)  # -> Geometry, Transform
Z_3 = UnitZ(Factor=Slider(15.065, range=0..90))
line = Line(move_3.Geometry)
edgesrf = EdgeSurface(CurveA=ln, CurveB=line)
move_4 = Move(Geometry=Z_3, Motion=pt)  # -> Geometry, Transform
extr_2 = Extrude(Base=edgesrf, Direction=move_4.Geometry)
rotax = RotateAxis(Geometry=extr_2, Angle=Slider(5.692, range=0..10), Axis=ln)  # -> Geometry, Transform

debrep = DeconstructBrep(Brep=extr)  # -> Faces, Edges, Vertices
panel = Panel(debrep.Faces)
move_5 = Move(Geometry=Z, Motion=pt)  # -> Geometry, Transform
move_6 = Move(Geometry=X, Motion=move_5.Geometry)  # -> Geometry, Transform
pt_4 = Point(move_6.Geometry)
scale = Scale(Geometry=extr, Center=pt_4, Factor=Slider(0.627, range=0..1))  # -> Geometry, Transform
inside = Geometry(scale.Geometry)
